# Grasshopper definition RozvanyDraw.gh (Grasshopper 1.0.7)
# plug-ins: Kangaroo2 Components, Kangaroo Components

pipeline = GeometryPipeline(
    GroupByLayer=False,
    GroupByType=False,
    IncludeHidden=True,
    IncludeLocked=True,
    LayerFilter="Clamped boundary",
    NameFilter="*",
    SublayerFiltering=False,
    TypeFilter=4)
pipeline_2 = GeometryPipeline(
    GroupByLayer=False,
    GroupByType=False,
    IncludeHidden=True,
    IncludeLocked=True,
    LayerFilter="Clamped interior",
    NameFilter="*",
    SublayerFiltering=False,
    TypeFilter=1)
pipeline_3 = GeometryPipeline(
    GroupByLayer=False,
    GroupByType=False,
    IncludeHidden=True,
    IncludeLocked=True,
    LayerFilter="Clamped interior",
    NameFilter="*",
    SublayerFiltering=False,
    TypeFilter=4)

boundarypoints = GetPoint(AtLeast=3, AtMost=2147483647, Realtime=True)
lnpoints = GetPoint(AtLeast=1, AtMost=2147483647, Realtime=True)
arcpoints = GetPoint(AtLeast=1, AtMost=2147483647, Realtime=True)
geo = Geometry([<point referenced from the Rhino model> x2])
item = ListItem(List=arcpoints, Index=0, Wrap=True)  # -> Item, Item1, Item2
pline = PolyLine(Vertices=flatten(lnpoints), Closed=False)  # -> simplify(Polyline)
pline_2 = PolyLine(Vertices=flatten(boundarypoints), Closed=invert(False))
arc = Arc3Pt(PointA=item.Item, PointB=item.Item1, PointC=item.Item2)  # -> simplify(Arc), Plane, Radius
len = Length(Curve=pline)

pipeline_4 = GeometryPipeline(
    GroupByLayer=False,
    GroupByType=False,
    IncludeHidden=True,
    IncludeLocked=True,
    LayerFilter="Clamped boundary",
    NameFilter="*",
    SublayerFiltering=False,
    TypeFilter=4)  # disabled
pipeline_5 = GeometryPipeline(
    GroupByLayer=False,
    GroupByType=False,
    IncludeHidden=True,
    IncludeLocked=True,
    LayerFilter="Clamped interior",
    NameFilter="*",
    SublayerFiltering=False,
    TypeFilter=1)  # disabled
pipeline_6 = GeometryPipeline(
    GroupByLayer=False,
    GroupByType=False,
    IncludeHidden=True,
    IncludeLocked=True,
    LayerFilter="Clamped interior",
    NameFilter="*",
    SublayerFiltering=False,
    TypeFilter=4)  # disabled

geo_2 = Geometry([<point referenced from the Rhino model> x2])  # disabled
pline_3 = PolyLine(Vertices=geo_2, Closed=False)  # -> simplify(Polyline); disabled
colpoints = GetPoint(AtLeast=0, AtMost=2147483647, Realtime=True)

len_2 = Length(Curve=pipeline_6)  # disabled
number_slider = Slider(1, range=1..20)  # disabled
division = Division(A=len_2, B=number_slider)  # disabled
round = Round(Number=division)  # -> Nearest, Floor, Ceiling; disabled
divide = DivideCurve(Curve=simplify(graft(pipeline_6)), Count=simplify(graft(round.Nearest)), Kinks=False)  # -> Points, Tangents, Parameters; disabled
pline_4 = PolyLine(Vertices=divide.Points, Closed=False)  # disabled
pt = Point(divide.Points)  # disabled

explode = Explode(Curve=pipeline_4, Recursive=True)  # -> Segments, Vertices; disabled
len_3 = Length(Curve=explode.Segments)  # disabled
division_2 = Division(A=len_3, B=number_slider)  # disabled
round_2 = Round(Number=division_2)  # -> Nearest, Floor, Ceiling; disabled
divide_2 = DivideCurve(Curve=explode.Segments, Count=round_2.Nearest, Kinks=False)  # -> Points, Tangents, Parameters; disabled
pline_5 = PolyLine(Vertices=divide_2.Points, Closed=False)  # disabled
end = EndPoints(Curve=graft(pline_5))  # -> Start, End; disabled
crv = Curve(pline_5)  # disabled
merge = Merge(Data1=end.Start, Data2=end.End)  # disabled
pt_2 = Point(merge)  # disabled
pt_3 = Point(divide_2.Points)  # disabled

len_4 = Length(Curve=pline_3)  # disabled
pt_4 = Point(colpoints)
division_3 = Division(A=len_4, B=number_slider)  # disabled
round_3 = Round(Number=division_3)  # -> Nearest, Floor, Ceiling; disabled
divide_3 = DivideCurve(Curve=simplify(graft(pline_3)), Count=simplify(graft(round_3.Nearest)), Kinks=False)  # -> Points, Tangents, Parameters; disabled
pt_5 = Point(divide_3.Points)  # disabled
pt_6 = Point(pipeline_5)  # disabled
merge_2 = Merge(Data1=pt_5, Data2=pt)  # disabled
panel = Panel("""1
2""")
int = Integer(panel)
neg = Negative(Value=Slider(2, range=0..10))
number_slider_2 = Slider(0.5, range=0..1)
panel_2 = Panel("""1
2""")  # disabled
int_2 = Integer(panel_2)  # disabled
number_slider_3 = Slider(2, range=0..10)  # disabled
neg_2 = Negative(Value=number_slider_3)  # disabled
number_slider_4 = Slider(0.5, range=0..1)  # disabled
number_slider_5 = Slider(1, range=0..1)
number_slider_6 = Slider(0.5, range=0..1)
number_slider_7 = Slider(0, range=0..16)
number_slider_8 = Slider(5, range=0..16)
number_slider_9 = Slider(1, range=0..1)  # disabled
number_slider_10 = Slider(0.5, range=0..1)  # disabled

explode_2 = Explode(Curve=pline_2, Recursive=True)  # -> Segments, Vertices
len_5 = Length(Curve=explode_2.Segments)

len_6 = Length(Curve=arc.Arc)
number_slider_11 = Slider(10, range=10..20)

spacing = GetNumber(number_slider_11, AtLeast=1, AtMost=2147483647, Maximum=1.797693135e+308, Minimum=-1.797693135e+308)

division_4 = Division(A=len_6, B=spacing)
round_4 = Round(Number=division_4)  # -> Nearest, Floor, Ceiling
divide_4 = DivideCurve(Curve=simplify(graft(arc.Arc)), Count=simplify(graft(round_4.Nearest)), Kinks=False)  # -> Points, Tangents, Parameters
pline_6 = PolyLine(Vertices=divide_4.Points, Closed=False)
pt_7 = Point(divide_4.Points)

division_5 = Division(A=len_5, B=spacing)
round_5 = Round(Number=division_5)  # -> Nearest, Floor, Ceiling
divide_5 = DivideCurve(Curve=explode_2.Segments, Count=round_5.Nearest, Kinks=False)  # -> Points, Tangents, Parameters
pline_7 = PolyLine(Vertices=divide_5.Points, Closed=False)
pt_8 = Point(divide_5.Points)

division_6 = Division(A=len, B=spacing)
round_6 = Round(Number=division_6)  # -> Nearest, Floor, Ceiling
divide_6 = DivideCurve(Curve=simplify(graft(pline)), Count=simplify(graft(round_6.Nearest)), Kinks=False)  # -> Points, Tangents, Parameters
pline_8 = PolyLine(Vertices=divide_6.Points, Closed=False)
pt_9 = Point(divide_6.Points)
merge_3 = Merge(Data1=pt_9, Data2=pt_7)

entwine = Entwine(Branch0X=simplify(merge_3), Branch1X=simplify(graft(pt_4)), Branch2X=simplify(pt_8), FlattenInputs=False)

pt_10 = Point(entwine)

voronoi = Voronoi(Points=flatten(pt_10), BruteForceOverride=False)

unflatten = UnflattenTree(Tree=voronoi, Guide=pt_10)
runion = RegionUnion(Curves=unflatten)
trim = TrimWithRegion(Curve=runion, Region=pline_2)  # -> Inside, Outside
merge_4 = Merge(Data1=trim.Inside, Data2=pline_2)

entwine_2 = Entwine(Branch0X=simplify(merge_2), Branch1X=simplify(graft(pt_6)), Branch2X=simplify(pt_3), FlattenInputs=False)  # disabled

pt_11 = Point(entwine_2)  # disabled

voronoi_2 = Voronoi(Points=flatten(pt_11), BruteForceOverride=False)  # disabled

unflatten_2 = UnflattenTree(Tree=voronoi_2, Guide=pt_11)  # disabled
runion_2 = RegionUnion(Curves=unflatten_2)  # disabled
trim_2 = TrimWithRegion(Curve=runion_2, Region=pipeline_4)  # -> Inside, Outside; disabled
merge_5 = Merge(Data1=trim_2.Inside, Data2=pipeline_4)  # disabled

crv_2 = Curve(merge_4)
explode_3 = Explode(Curve=flatten(crv_2), Recursive=True)  # -> Segments, Vertices
dupln = RemoveDuplicateLines(Lines=flatten(explode_3.Segments), Tolerance=Slider(0.005, range=0..0.01))
join = JoinCurves(Curves=dupln, Preserve=False)
mcx = MultipleCurves(Curves=join)  # -> Points, IndexA, IndexB, ParamA, ParamB
Z = UnitZ(Factor=1)
line = LineSDL(Start=mcx.Points, Direction=Z, Length=1)
ccx = CurveCurve(CurveA=graft(crv_2), CurveB=line)  # -> Points, ParamsA, ParamsB
pshift = ShiftPaths(Data=simplify(ccx.ParamsA), Offset=-1)
shatter = Shatter(Curve=graft(crv_2), Parameters=pshift)
eval = EvaluateLength(Curve=flatten(shatter), Length=Slider(0.5, range=0..1), Normalized=True)  # -> Point, Tangent, Parameter

cullpt = CullDuplicates(Points=eval.Point, Tolerance=Slider(0.05, range=0..1), CullMode=1)  # -> Points, Indices, Valence

crv_3 = Curve(merge_5)  # disabled
number_slider_12 = Slider(0.005, range=0..0.01)  # disabled
explode_4 = Explode(Curve=flatten(crv_3), Recursive=True)  # -> Segments, Vertices; disabled
dupln_2 = RemoveDuplicateLines(Lines=flatten(explode_4.Segments), Tolerance=number_slider_12)  # disabled
join_2 = JoinCurves(Curves=dupln_2, Preserve=False)  # disabled
mcx_2 = MultipleCurves(Curves=join_2)  # -> Points, IndexA, IndexB, ParamA, ParamB; disabled
Z_2 = UnitZ(Factor=1)  # disabled
line_2 = LineSDL(Start=mcx_2.Points, Direction=Z_2, Length=1)  # disabled
ccx_2 = CurveCurve(CurveA=graft(crv_3), CurveB=line_2)  # -> Points, ParamsA, ParamsB; disabled
pshift_2 = ShiftPaths(Data=simplify(ccx_2.ParamsA), Offset=-1)  # disabled
number_slider_13 = Slider(0.5, range=0..1)  # disabled
number_slider_14 = Slider(0.05, range=0..1)  # disabled
shatter_2 = Shatter(Curve=graft(crv_3), Parameters=pshift_2)  # disabled
eval_2 = EvaluateLength(Curve=flatten(shatter_2), Length=number_slider_13, Normalized=True)  # -> Point, Tangent, Parameter; disabled
number_slider_15 = Slider(0.5, range=0..1)  # disabled

cullpt_2 = CullDuplicates(Points=eval_2.Point, Tolerance=0.1, CullMode=1)  # -> Points, Indices, Valence; disabled

cull_i = CullIndex(List=flatten(shatter), Indices=cullpt.Indices, Wrap=False)
eval_3 = EvaluateLength(Curve=flatten(cull_i), Length=Slider(0.5, range=0..1), Normalized=True)  # -> Point, Tangent, Parameter

merge_6 = Merge(Data1=cull_i, Data2=pline_6, Data3=pline_8, Data4=pline_2)  # -> flatten(Result)

len_7 = Length(Curve=merge_6)
division_7 = Division(A=len_7, B=spacing)
round_7 = Round(Number=division_7)  # -> Nearest, Floor, Ceiling
divide_7 = DivideCurve(Curve=merge_6, Count=round_7.Nearest, Kinks=False)  # -> Points, Tangents, Parameters

merge_7 = Merge(Data1=divide_7.Points, Data2=pt_4)
cullpt_3 = CullDuplicates(Points=flatten(merge_7), Tolerance=0.1, CullMode=3)  # -> Points, Indices, Valence
voronoi_3 = Voronoi(Points=flatten(cullpt_3.Points), BruteForceOverride=False)

incurve = PointInCurve(Point=graft(pt_4), Curve=voronoi_3)  # -> Relationship, Point
trim_3 = TrimWithRegion(Curve=voronoi_3, Region=pline_2)  # -> Inside, Outside
entwine_3 = Entwine(Branch0X=simplify(divide_7.Points), Branch1X=simplify(graft(pt_4)), FlattenInputs=False)
mindex = MemberIndex(Set=incurve.Relationship, Member=2)  # -> Index, Count
clean = CleanTree(RemoveNulls=True, RemoveInvalid=True, RemoveEmpty=False, Tree=trim_3.Inside)
item_2 = ListItem(List=voronoi_3, Index=mindex.Index, Wrap=True)
len_8 = Length(Curve=item_2)
division_8 = Division(A=len_8, B=number_slider_11)
incurve_2 = PointInCurve(Point=graft(entwine_3), Curve=voronoi_3)  # -> Relationship, Point
round_8 = Round(Number=division_8)  # -> Nearest, Floor, Ceiling
divide_8 = DivideCurve(Curve=item_2, Count=round_8.Nearest, Kinks=False)  # -> Points, Tangents, Parameters
mindex_2 = MemberIndex(Set=incurve_2.Relationship, Member=int)  # -> Index, Count
ln = Line(StartPoint=graft(pt_4), EndPoint=divide_8.Points)  # -> flatten(Line)
item_3 = ListItem(List=voronoi_3, Index=mindex_2.Index, Wrap=True)
pshift_3 = ShiftPaths(Data=simplify(item_3), Offset=neg)
runion_3 = RegionUnion(Curves=pshift_3)  # -> flatten(Result)
explode_5 = Explode(Curve=runion_3, Recursive=True)  # -> flatten(Segments), Vertices
explode_6 = Explode(Curve=pshift_3, Recursive=True)  # -> flatten(Segments), Vertices
dupln_3 = RemoveDuplicateLines(Lines=explode_5.Segments, Tolerance=0.01)
dupln_4 = RemoveDuplicateLines(Lines=explode_6.Segments, Tolerance=0.01)
eval_4 = EvaluateLength(Curve=dupln_4, Length=number_slider_2, Normalized=True)  # -> Point, Tangent, Parameter
eval_5 = EvaluateLength(Curve=dupln_3, Length=number_slider_2, Normalized=True)  # -> Point, Tangent, Parameter
difference = SetDifference(SetA=eval_4.Point, SetB=eval_5.Point)
mindex_3 = MemberIndex(Set=eval_4.Point, Member=difference)  # -> flatten(Index), Count
cset = CreateSet(List=mindex_3.Index)  # -> Set, Map
item_4 = ListItem(List=dupln_4, Index=cset.Set, Wrap=False)
explode_7 = Explode(Curve=clean, Recursive=True)  # -> Segments, Vertices
dupln_5 = RemoveDuplicateLines(Lines=flatten(explode_7.Segments), Tolerance=0.01)
colom = CollisionOneMany(Collider=flatten(dupln_5), Obstacles=flatten(explode_2.Segments))  # -> Collision, Index
dispatch = Dispatch(List=flatten(dupln_5), DispatchPattern=colom.Collision)  # -> ListA, ListB
geo_3 = Geometry(item_4)
colom_2 = CollisionOneMany(Collider=flatten(geo_3), Obstacles=flatten(pline))  # -> Collision, Index
dispatch_2 = Dispatch(List=flatten(geo_3), DispatchPattern=colom_2.Collision)  # -> ListA, flatten(ListB)
geo_4 = Geometry(dispatch.ListA)
flip = FlipCurve(Curve=geo_4)  # -> Curve, Flag
geo_5 = Geometry(dispatch_2.ListA)
dash = DashPattern(Curve=graft([flip.Curve, geo_5]), Pattern=[number_slider_7, number_slider_8])  # -> Dashes, Gaps
dash_2 = DashPattern(Curve=graft(ln), Pattern=[number_slider_7, number_slider_8])  # -> Dashes, Gaps
cull_i_2 = CullIndex(List=dash_2.Dashes, Indices=0, Wrap=True)  # -> flatten(List)
clean_2 = CleanTree(RemoveNulls=True, RemoveInvalid=True, RemoveEmpty=False, Tree=[cull_i_2, dash.Dashes, dispatch_2.ListB])

# ---- group: RH_OUT: curves
geo_6 = Geometry(clean_2)

# ----
cull_i_3 = CullIndex(List=flatten(shatter_2), Indices=cullpt_2.Indices, Wrap=False)  # disabled
eval_6 = EvaluateLength(Curve=flatten(cull_i_3), Length=number_slider_15, Normalized=True)  # -> Point, Tangent, Parameter; disabled

merge_8 = Merge(Data1=cull_i_3, Data2=pline_4, Data3=pline_3)  # -> flatten(Result); disabled

len_9 = Length(Curve=merge_8)  # disabled
division_9 = Division(A=len_9, B=number_slider)  # disabled
round_9 = Round(Number=division_9)  # -> Nearest, Floor, Ceiling; disabled
divide_9 = DivideCurve(Curve=merge_8, Count=round_9.Nearest, Kinks=False)  # -> Points, Tangents, Parameters; disabled

merge_9 = Merge(Data1=simplify(divide_9.Points), Data2=simplify(pt_6), Data3=pt_3)  # disabled
cullpt_4 = CullDuplicates(Points=flatten(merge_9), Tolerance=0.1, CullMode=3)  # -> Points, Indices, Valence; disabled
voronoi_4 = Voronoi(Points=flatten(cullpt_4.Points), BruteForceOverride=False)  # disabled
trim_4 = TrimWithRegion(Curve=voronoi_4, Region=pipeline_4)  # -> Inside, Outside; disabled
clean_3 = CleanTree(RemoveNulls=True, RemoveInvalid=True, RemoveEmpty=False, Tree=trim_4.Inside)  # disabled

# ---- group: In
incurve_3 = PointInCurve(Point=graft(pt_6), Curve=voronoi_4)  # -> Relationship, Point; disabled
mindex_4 = MemberIndex(Set=incurve_3.Relationship, Member=2)  # -> Index, Count; disabled
item_5 = ListItem(List=voronoi_4, Index=mindex_4.Index, Wrap=True)  # disabled
len_10 = Length(Curve=item_5)  # disabled
division_10 = Division(A=len_10, B=number_slider)  # disabled
round_10 = Round(Number=division_10)  # -> Nearest, Floor, Ceiling; disabled
divide_10 = DivideCurve(Curve=item_5, Count=round_10.Nearest, Kinks=False)  # -> Points, Tangents, Parameters; disabled
ln_2 = Line(StartPoint=graft(pt_6), EndPoint=divide_10.Points)  # disabled

# ----
entwine_4 = Entwine(Branch0X=simplify(divide_9.Points), Branch1X=simplify(graft(pt_6)), FlattenInputs=False)  # disabled
incurve_4 = PointInCurve(Point=graft(entwine_4), Curve=voronoi_4)  # -> Relationship, Point; disabled
mindex_5 = MemberIndex(Set=incurve_4.Relationship, Member=int_2)  # -> Index, Count; disabled
item_6 = ListItem(List=voronoi_4, Index=mindex_5.Index, Wrap=True)  # disabled
pshift_4 = ShiftPaths(Data=simplify(item_6), Offset=neg_2)  # disabled
runion_4 = RegionUnion(Curves=pshift_4)  # -> flatten(Result); disabled
explode_8 = Explode(Curve=pshift_4, Recursive=True)  # -> flatten(Segments), Vertices; disabled
explode_9 = Explode(Curve=runion_4, Recursive=True)  # -> flatten(Segments), Vertices; disabled
dupln_6 = RemoveDuplicateLines(Lines=explode_8.Segments, Tolerance=0.01)  # disabled
dupln_7 = RemoveDuplicateLines(Lines=explode_9.Segments, Tolerance=0.01)  # disabled
eval_7 = EvaluateLength(Curve=dupln_6, Length=number_slider_4, Normalized=True)  # -> Point, Tangent, Parameter; disabled
eval_8 = EvaluateLength(Curve=dupln_7, Length=number_slider_4, Normalized=True)  # -> Point, Tangent, Parameter; disabled
difference_2 = SetDifference(SetA=eval_7.Point, SetB=eval_8.Point)  # disabled
mindex_6 = MemberIndex(Set=eval_7.Point, Member=difference_2)  # -> flatten(Index), Count; disabled
cset_2 = CreateSet(List=mindex_6.Index)  # -> Set, Map; disabled
item_7 = ListItem(List=dupln_6, Index=cset_2.Set, Wrap=False)  # disabled
explode_10 = Explode(Curve=clean_3, Recursive=True)  # -> Segments, Vertices; disabled
dupln_8 = RemoveDuplicateLines(Lines=flatten(explode_10.Segments), Tolerance=0.01)  # disabled
colom_3 = CollisionOneMany(Collider=flatten(dupln_8), Obstacles=flatten(explode.Segments))  # -> Collision, Index; disabled
dispatch_3 = Dispatch(List=flatten(dupln_8), DispatchPattern=colom_3.Collision)  # -> ListA, ListB; disabled
geo_7 = Geometry(item_7)  # disabled
colom_4 = CollisionOneMany(Collider=flatten(geo_7), Obstacles=flatten(pipeline_6))  # -> Collision, Index; disabled
dispatch_4 = Dispatch(List=flatten(geo_7), DispatchPattern=colom_4.Collision)  # -> ListA, ListB; disabled
geo_8 = Geometry(dispatch_3.ListA)  # disabled
flip_2 = FlipCurve(Curve=geo_8)  # -> Curve, Flag; disabled
geo_9 = Geometry(dispatch_4.ListA)  # disabled
crv_4 = Curve(ln_2)  # disabled
dash_3 = DashPattern(Curve=graft(crv_4), Pattern=[number_slider_9, number_slider_10])  # -> Dashes, Gaps; disabled
dash_4 = DashPattern(Curve=graft([flip_2.Curve, geo_9]), Pattern=[number_slider_9, number_slider_10])  # -> Dashes, Gaps; disabled
cull_i_4 = CullIndex(List=dash_3.Dashes, Indices=0, Wrap=False)  # disabled
geo_10 = Geometry(dash_4.Dashes)  # disabled
geo_11 = Geometry(dispatch_4.ListB)  # disabled
geo_12 = Geometry(cull_i_4)  # disabled
