# Grasshopper definition RozvanyDraw01.gh (Grasshopper 1.0.7)
# plug-ins: Kangaroo2 Components

pipeline = GeometryPipeline(
    GroupByLayer=False,
    GroupByType=False,
    IncludeHidden=True,
    IncludeLocked=True,
    LayerFilter="Clamped boundary",
    NameFilter="*",
    SublayerFiltering=False,
    TypeFilter=1)
pipeline_2 = GeometryPipeline(
    GroupByLayer=False,
    GroupByType=False,
    IncludeHidden=True,
    IncludeLocked=True,
    LayerFilter="colPoints",
    NameFilter="*",
    SublayerFiltering=False,
    TypeFilter=1)
pipeline_3 = GeometryPipeline(
    GroupByLayer=False,
    GroupByType=False,
    IncludeHidden=True,
    IncludeLocked=True,
    LayerFilter="Clamped interior",
    NameFilter="*",
    SublayerFiltering=False,
    TypeFilter=1)

pipeline_4 = GeometryPipeline(
    GroupByLayer=False,
    GroupByType=False,
    IncludeHidden=True,
    IncludeLocked=True,
    LayerFilter="Clamped boundary",
    NameFilter="*",
    SublayerFiltering=False,
    TypeFilter=1)
pipeline_5 = GeometryPipeline(
    GroupByLayer=False,
    GroupByType=False,
    IncludeHidden=True,
    IncludeLocked=True,
    LayerFilter="colPoints",
    NameFilter="*",
    SublayerFiltering=False,
    TypeFilter=1)
pipeline_6 = GeometryPipeline(
    GroupByLayer=False,
    GroupByType=False,
    IncludeHidden=True,
    IncludeLocked=True,
    LayerFilter="Clamped interior",
    NameFilter="*",
    SublayerFiltering=False,
    TypeFilter=1)

number_slider = Slider(10, range=1..20)

number_slider_2 = Slider(1, range=1..20)

boundarypoints = GetPoint(AtLeast=3, AtMost=2147483647, Realtime=True)
lnpoints = GetPoint(AtLeast=1, AtMost=2147483647, Realtime=True)
pline = PolyLine(Vertices=flatten(lnpoints), Closed=False)  # -> simplify(Polyline)
pline_2 = PolyLine(Vertices=flatten(boundarypoints), Closed=invert(False))
explode = Explode(Curve=pline, Recursive=True)  # -> Segments, Vertices
len = Length(Curve=explode.Segments)
division = Division(A=len, B=number_slider)
round = Round(Number=division)  # -> Nearest, Floor, Ceiling
divide = DivideCurve(Curve=simplify(graft(explode.Segments)), Count=simplify(graft(round.Nearest)), Kinks=False)  # -> Points, Tangents, Parameters
colpoints = GetPoint(AtLeast=0, AtMost=2147483647, Realtime=True)
pline_3 = PolyLine(Vertices=divide.Points, Closed=False)
pt = Point(colpoints)
panel = Panel("""1
2""")
int = Integer(panel)
neg = Negative(Value=Slider(2, range=0..10))
number_slider_3 = Slider(0.5, range=0..1)
explode_2 = Explode(Curve=explode.Segments, Recursive=True)  # -> Segments, Vertices
number_slider_4 = Slider(5, range=0..16)
number_slider_5 = Slider(10, range=0..16)

explode_3 = Explode(Curve=pline_2, Recursive=True)  # -> Segments, Vertices
len_2 = Length(Curve=explode_3.Segments)
division_2 = Division(A=len_2, B=number_slider)
round_2 = Round(Number=division_2)  # -> Nearest, Floor, Ceiling
divide_2 = DivideCurve(Curve=explode_3.Segments, Count=round_2.Nearest, Kinks=False)  # -> Points, Tangents, Parameters
pline_4 = PolyLine(Vertices=divide_2.Points, Closed=False)
pt_2 = Point(divide_2.Points)

pline_5 = PolyLine(Vertices=flatten(pipeline_6), Closed=False)  # -> simplify(Polyline)
pline_6 = PolyLine(Vertices=flatten(pipeline_4), Closed=invert(False))
len_3 = Length(Curve=pline_5)
division_3 = Division(A=len_3, B=number_slider_2)
round_3 = Round(Number=division_3)  # -> Nearest, Floor, Ceiling
divide_3 = DivideCurve(Curve=simplify(graft(pline_5)), Count=simplify(graft(round_3.Nearest)), Kinks=False)  # -> Points, Tangents, Parameters
pline_7 = PolyLine(Vertices=divide_3.Points, Closed=False)
pt_3 = Point(pipeline_5)
panel_2 = Panel("""1
2""")
int_2 = Integer(panel_2)
neg_2 = Negative(Value=Slider(2, range=0..10))
number_slider_6 = Slider(0.5, range=0..1)
explode_4 = Explode(Curve=pline_5, Recursive=True)  # -> Segments, Vertices
number_slider_7 = Slider(0.475, range=0..16)
number_slider_8 = Slider(0.857, range=0..16)

explode_5 = Explode(Curve=pline_6, Recursive=True)  # -> Segments, Vertices
len_4 = Length(Curve=explode_5.Segments)
division_4 = Division(A=len_4, B=number_slider_2)
round_4 = Round(Number=division_4)  # -> Nearest, Floor, Ceiling
divide_4 = DivideCurve(Curve=explode_5.Segments, Count=round_4.Nearest, Kinks=False)  # -> Points, Tangents, Parameters
pline_8 = PolyLine(Vertices=divide_4.Points, Closed=False)
pt_4 = Point(divide_4.Points)

entwine = Entwine(Branch0X=simplify(divide.Points), Branch1X=simplify(graft(pt)), Branch2X=simplify(pt_2), FlattenInputs=False)

entwine_2 = Entwine(Branch0X=simplify(divide_3.Points), Branch1X=simplify(graft(pt_3)), Branch2X=simplify(pt_4), FlattenInputs=False)

pt_5 = Point(entwine)

voronoi = Voronoi(Points=flatten(pt_5), BruteForceOverride=False)

pt_6 = Point(entwine_2)

voronoi_2 = Voronoi(Points=flatten(pt_6), BruteForceOverride=False)

unflatten = UnflattenTree(Tree=voronoi, Guide=pt_5)
runion = RegionUnion(Curves=unflatten)
trim = TrimWithRegion(Curve=runion, Region=pline_2)  # -> Inside, Outside
merge = Merge(Data1=trim.Inside, Data2=pline_2)

unflatten_2 = UnflattenTree(Tree=voronoi_2, Guide=pt_6)
runion_2 = RegionUnion(Curves=unflatten_2)
trim_2 = TrimWithRegion(Curve=runion_2, Region=pline_6)  # -> Inside, Outside
merge_2 = Merge(Data1=trim_2.Inside, Data2=pline_6)

crv = Curve(merge)
explode_6 = Explode(Curve=flatten(crv), Recursive=True)  # -> Segments, Vertices
dupln = RemoveDuplicateLines(Lines=flatten(explode_6.Segments), Tolerance=Slider(0.005, range=0..0.01))
join = JoinCurves(Curves=dupln, Preserve=False)
mcx = MultipleCurves(Curves=join)  # -> Points, IndexA, IndexB, ParamA, ParamB
Z = UnitZ(Factor=1)
line = LineSDL(Start=mcx.Points, Direction=Z, Length=1)
ccx = CurveCurve(CurveA=graft(crv), CurveB=line)  # -> Points, ParamsA, ParamsB
pshift = ShiftPaths(Data=simplify(ccx.ParamsA), Offset=-1)
shatter = Shatter(Curve=graft(crv), Parameters=pshift)
eval = EvaluateLength(Curve=flatten(shatter), Length=Slider(0.5, range=0..1), Normalized=True)  # -> Point, Tangent, Parameter

crv_2 = Curve(merge_2)
explode_7 = Explode(Curve=flatten(crv_2), Recursive=True)  # -> Segments, Vertices
dupln_2 = RemoveDuplicateLines(Lines=flatten(explode_7.Segments), Tolerance=Slider(0.005, range=0..0.01))
join_2 = JoinCurves(Curves=dupln_2, Preserve=False)
mcx_2 = MultipleCurves(Curves=join_2)  # -> Points, IndexA, IndexB, ParamA, ParamB
Z_2 = UnitZ(Factor=1)
line_2 = LineSDL(Start=mcx_2.Points, Direction=Z_2, Length=1)
ccx_2 = CurveCurve(CurveA=graft(crv_2), CurveB=line_2)  # -> Points, ParamsA, ParamsB
pshift_2 = ShiftPaths(Data=simplify(ccx_2.ParamsA), Offset=-1)
shatter_2 = Shatter(Curve=graft(crv_2), Parameters=pshift_2)
eval_2 = EvaluateLength(Curve=flatten(shatter_2), Length=Slider(0.5, range=0..1), Normalized=True)  # -> Point, Tangent, Parameter

cullpt = CullDuplicates(Points=eval.Point, Tolerance=Slider(0.05, range=0..1), CullMode=1)  # -> Points, Indices, Valence

cullpt_2 = CullDuplicates(Points=eval_2.Point, Tolerance=Slider(0.05, range=0..1), CullMode=1)  # -> Points, Indices, Valence

cull_i = CullIndex(List=flatten(shatter), Indices=cullpt.Indices, Wrap=False)
eval_3 = EvaluateLength(Curve=flatten(cull_i), Length=Slider(0.5, range=0..1), Normalized=True)  # -> Point, Tangent, Parameter

cull_i_2 = CullIndex(List=flatten(shatter_2), Indices=cullpt_2.Indices, Wrap=False)
eval_4 = EvaluateLength(Curve=flatten(cull_i_2), Length=Slider(0.5, range=0..1), Normalized=True)  # -> Point, Tangent, Parameter

merge_3 = Merge(Data1=cull_i, Data2=pline_3, Data3=pline_2)  # -> flatten(Result)

len_5 = Length(Curve=merge_3)
division_5 = Division(A=len_5, B=number_slider)
round_5 = Round(Number=division_5)  # -> Nearest, Floor, Ceiling
divide_5 = DivideCurve(Curve=merge_3, Count=round_5.Nearest, Kinks=False)  # -> Points, Tangents, Parameters

merge_4 = Merge(Data1=divide_5.Points, Data2=pt)
cullpt_3 = CullDuplicates(Points=flatten(merge_4), Tolerance=0.1, CullMode=3)  # -> Points, Indices, Valence
voronoi_3 = Voronoi(Points=flatten(cullpt_3.Points), BruteForceOverride=False)

incurve = PointInCurve(Point=graft(pt), Curve=voronoi_3)  # -> Relationship, Point
trim_3 = TrimWithRegion(Curve=voronoi_3, Region=pline_2)  # -> Inside, Outside
mindex = MemberIndex(Set=incurve.Relationship, Member=2)  # -> Index, Count
clean = CleanTree(RemoveNulls=True, RemoveInvalid=True, RemoveEmpty=False, Tree=trim_3.Inside)
item = ListItem(List=voronoi_3, Index=mindex.Index, Wrap=True)
entwine_3 = Entwine(Branch0X=simplify(divide_5.Points), Branch1X=simplify(graft(pt)), FlattenInputs=False)
crv_3 = Curve(clean)
len_6 = Length(Curve=item)
incurve_2 = PointInCurve(Point=graft(entwine_3), Curve=voronoi_3)  # -> Relationship, Point
division_6 = Division(A=len_6, B=number_slider)
round_6 = Round(Number=division_6)  # -> Nearest, Floor, Ceiling
divide_6 = DivideCurve(Curve=item, Count=round_6.Nearest, Kinks=False)  # -> Points, Tangents, Parameters
mindex_2 = MemberIndex(Set=incurve_2.Relationship, Member=int)  # -> Index, Count
ln = Line(StartPoint=graft(pt), EndPoint=divide_6.Points)  # -> flatten(Line)
item_2 = ListItem(List=voronoi_3, Index=mindex_2.Index, Wrap=True)
pshift_3 = ShiftPaths(Data=simplify(item_2), Offset=neg)
runion_3 = RegionUnion(Curves=pshift_3)  # -> flatten(Result)
explode_8 = Explode(Curve=pshift_3, Recursive=True)  # -> flatten(Segments), Vertices
explode_9 = Explode(Curve=runion_3, Recursive=True)  # -> flatten(Segments), Vertices
dupln_3 = RemoveDuplicateLines(Lines=explode_9.Segments, Tolerance=0.01)
dupln_4 = RemoveDuplicateLines(Lines=explode_8.Segments, Tolerance=0.01)
eval_5 = EvaluateLength(Curve=dupln_4, Length=number_slider_3, Normalized=True)  # -> Point, Tangent, Parameter
eval_6 = EvaluateLength(Curve=dupln_3, Length=number_slider_3, Normalized=True)  # -> Point, Tangent, Parameter
difference = SetDifference(SetA=eval_5.Point, SetB=eval_6.Point)
mindex_3 = MemberIndex(Set=eval_5.Point, Member=difference)  # -> flatten(Index), Count
cset = CreateSet(List=mindex_3.Index)  # -> Set, Map
item_3 = ListItem(List=dupln_4, Index=cset.Set, Wrap=False)
trim_4 = TrimWithRegion(Curve=item_3, Region=pline_2)  # -> Inside, Outside
geo = Geometry(trim_4.Inside)
geo_2 = Geometry(trim_4.Outside)
lng = ListLength(List=geo_2)
larger = LargerThan(FirstNumber=lng, SecondNumber="0")  # -> LargerThan, OrEqualTo
tstat = TreeStatistics(Tree=trim_4.Inside)  # -> Paths, Length, Count
dispatch = Dispatch(List=tstat.Paths, DispatchPattern=flatten(larger.LargerThan))  # -> ListA, ListB
branch = TreeBranch(Tree=trim_4.Inside, Path=dispatch.ListB, MaintainPaths=True)  # -> flatten(Branch)
branch_2 = TreeBranch(Tree=trim_4.Inside, Path=dispatch.ListA, MaintainPaths=True)
colom = CollisionOneMany(Collider=branch, Obstacles=pline)  # -> Collision, Index
flip = FlipCurve(Curve=branch_2)  # -> flatten(Curve), Flag
dispatch_2 = Dispatch(List=flatten(branch), DispatchPattern=colom.Collision)  # -> ListA, ListB
geo_3 = Geometry(dispatch_2.ListA)
dash = DashPattern(Curve=graft(ln), Pattern=[number_slider_5, number_slider_4])  # -> Dashes, Gaps
dash_2 = DashPattern(Curve=graft(geo_3), Pattern=[number_slider_5, number_slider_4])  # -> flatten(Dashes), Gaps
dash_3 = DashPattern(Curve=graft(flip.Curve), Pattern=[number_slider_5, number_slider_4])  # -> Dashes, Gaps
cull_i_3 = CullIndex(List=dash.Dashes, Indices=0, Wrap=True)

# ---- group: RH_OUT: interior solid
crv_4 = Curve(dispatch_2.ListB)

# ---- group: RH_OUT: interior dashed
crv_5 = Curve(dash_2.Dashes)

# ---- group: RH_OUT: radial
crv_6 = Curve(cull_i_3)

# ---- group: RH_OUT:edges
crv_7 = Curve(dash_3.Dashes)

# ----
merge_5 = Merge(Data1=cull_i_2, Data2=pline_7, Data3=pline_6)  # -> flatten(Result)

len_7 = Length(Curve=merge_5)
division_7 = Division(A=len_7, B=number_slider_2)
round_7 = Round(Number=division_7)  # -> Nearest, Floor, Ceiling
divide_7 = DivideCurve(Curve=merge_5, Count=round_7.Nearest, Kinks=False)  # -> Points, Tangents, Parameters

merge_6 = Merge(Data1=divide_7.Points, Data2=pt_3)
cullpt_4 = CullDuplicates(Points=flatten(merge_6), Tolerance=0.1, CullMode=3)  # -> Points, Indices, Valence
voronoi_4 = Voronoi(Points=flatten(cullpt_4.Points), BruteForceOverride=False)

incurve_3 = PointInCurve(Point=graft(pt_3), Curve=voronoi_4)  # -> Relationship, Point
trim_5 = TrimWithRegion(Curve=voronoi_4, Region=pline_6)  # -> Inside, Outside
mindex_4 = MemberIndex(Set=incurve_3.Relationship, Member=2)  # -> Index, Count
clean_2 = CleanTree(RemoveNulls=True, RemoveInvalid=True, RemoveEmpty=False, Tree=trim_5.Inside)
item_4 = ListItem(List=voronoi_4, Index=mindex_4.Index, Wrap=True)
entwine_4 = Entwine(Branch0X=simplify(divide_7.Points), Branch1X=simplify(graft(pt_3)), FlattenInputs=False)
crv_8 = Curve(clean_2)
len_8 = Length(Curve=item_4)
incurve_4 = PointInCurve(Point=graft(entwine_4), Curve=voronoi_4)  # -> Relationship, Point
division_8 = Division(A=len_8, B=number_slider_2)
round_8 = Round(Number=division_8)  # -> Nearest, Floor, Ceiling
divide_8 = DivideCurve(Curve=item_4, Count=round_8.Nearest, Kinks=False)  # -> Points, Tangents, Parameters
mindex_5 = MemberIndex(Set=incurve_4.Relationship, Member=int_2)  # -> Index, Count
ln_2 = Line(StartPoint=graft(pt_3), EndPoint=divide_8.Points)  # -> flatten(Line)
item_5 = ListItem(List=voronoi_4, Index=mindex_5.Index, Wrap=True)
pshift_4 = ShiftPaths(Data=simplify(item_5), Offset=neg_2)
runion_4 = RegionUnion(Curves=pshift_4)  # -> flatten(Result)
explode_10 = Explode(Curve=pshift_4, Recursive=True)  # -> flatten(Segments), Vertices
explode_11 = Explode(Curve=runion_4, Recursive=True)  # -> flatten(Segments), Vertices
dupln_5 = RemoveDuplicateLines(Lines=explode_11.Segments, Tolerance=0.01)
dupln_6 = RemoveDuplicateLines(Lines=explode_10.Segments, Tolerance=0.01)
eval_7 = EvaluateLength(Curve=dupln_6, Length=number_slider_6, Normalized=True)  # -> Point, Tangent, Parameter
eval_8 = EvaluateLength(Curve=dupln_5, Length=number_slider_6, Normalized=True)  # -> Point, Tangent, Parameter
difference_2 = SetDifference(SetA=eval_7.Point, SetB=eval_8.Point)
mindex_6 = MemberIndex(Set=eval_7.Point, Member=difference_2)  # -> flatten(Index), Count
cset_2 = CreateSet(List=mindex_6.Index)  # -> Set, Map
item_6 = ListItem(List=dupln_6, Index=cset_2.Set, Wrap=False)
trim_6 = TrimWithRegion(Curve=item_6, Region=pline_6)  # -> Inside, Outside
geo_4 = Geometry(trim_6.Inside)
geo_5 = Geometry(trim_6.Outside)
lng_2 = ListLength(List=geo_5)
larger_2 = LargerThan(FirstNumber=lng_2, SecondNumber="0")  # -> LargerThan, OrEqualTo
tstat_2 = TreeStatistics(Tree=trim_6.Inside)  # -> Paths, Length, Count
dispatch_3 = Dispatch(List=tstat_2.Paths, DispatchPattern=flatten(larger_2.LargerThan))  # -> ListA, ListB
branch_3 = TreeBranch(Tree=trim_6.Inside, Path=dispatch_3.ListB, MaintainPaths=True)  # -> flatten(Branch)
branch_4 = TreeBranch(Tree=trim_6.Inside, Path=dispatch_3.ListA, MaintainPaths=True)
colom_2 = CollisionOneMany(Collider=branch_3, Obstacles=explode_4.Segments)  # -> Collision, Index
flip_2 = FlipCurve(Curve=branch_4)  # -> flatten(Curve), Flag
dispatch_4 = Dispatch(List=flatten(branch_3), DispatchPattern=colom_2.Collision)  # -> ListA, ListB
geo_6 = Geometry(dispatch_4.ListA)
dash_4 = DashPattern(Curve=graft(ln_2), Pattern=[number_slider_8, number_slider_7])  # -> Dashes, Gaps
dash_5 = DashPattern(Curve=graft(geo_6), Pattern=[number_slider_8, number_slider_7])  # -> flatten(Dashes), Gaps
dash_6 = DashPattern(Curve=graft(flip_2.Curve), Pattern=[number_slider_8, number_slider_7])  # -> Dashes, Gaps
cull_i_4 = CullIndex(List=dash_4.Dashes, Indices=0, Wrap=True)

line_3 = Line(dispatch_4.ListB)
line_4 = Line(dash_5.Dashes)
line_5 = Line(dash_6.Dashes)
line_6 = Line(cull_i_4)
