# Grasshopper definition RozvanyGrid.gh (Grasshopper 1.0.7)

type = GetInteger(Slider(0, range=0..2), AtLeast=1, AtMost=2147483647, Maximum=2147483647, Minimum=-2147483648)

xy = XYPlane(Origin=Point(0, 0, 0))

ex = GetInteger(Slider(5, range=0..10), AtLeast=1, AtMost=2147483647, Maximum=2147483647, Minimum=-2147483648)
spacing = GetInteger(Slider(1, range=0..10), AtLeast=1, AtMost=2147483647, Maximum=2147483647, Minimum=-2147483648)
ey = GetInteger(Slider(4, range=0..10), AtLeast=1, AtMost=2147483647, Maximum=2147483647, Minimum=-2147483648)

number_slider = Slider(3, range=0..10)
number_slider_2 = Slider(4, range=0..10)
number_slider_3 = Slider(1, range=0..10)
hexgrid = Hexagonal(Plane=PlaneXY(0, 0, 0), Size=spacing, ExtentX=ex, ExtentY=ey)  # -> Cells, Points
pt = Point(hexgrid.Points)
bbox = BoundingBox(Content=flatten(pt), Plane=PlaneXY(0, 0, 0), UnionBox=True)  # -> Box, Box_2
debrep = DeconstructBrep(Brep=bbox.Box)  # -> Faces, Edges, Vertices
join = JoinCurves(Curves=debrep.Edges, Preserve=False)
area = Area(Geometry=join)  # -> Area, Centroid
neg = Negative(Value=area.Centroid)
move = Move(Geometry=hexgrid.Cells, Motion=neg)  # -> Geometry, Transform
crv = Curve(move.Geometry)
move_2 = Move(Geometry=join, Motion=neg)  # -> Geometry, Transform
explode = Explode(Curve=crv, Recursive=True)  # -> Segments, Vertices
debrep_2 = DeconstructBrep(Brep=move_2.Geometry)  # -> Faces, Edges, Vertices
pt_2 = Point(explode.Vertices)
cullpt = CullDuplicates(Points=flatten(pt_2), Tolerance=0.1, CullMode=3)  # -> Points, Indices, Valence
xy_2 = XYPlane(Origin=Point(0, 0, 0))
voronoi = Voronoi(Points=cullpt.Points, Plane=xy_2, BruteForceOverride=False)
area_2 = Area(Geometry=crv)  # -> Area, Centroid
scale = Scale(Geometry=voronoi, Center=cullpt.Points, Factor=0.5)  # -> Geometry, Transform
scale_2 = Scale(Geometry=crv, Center=area_2.Centroid, Factor=0.5)  # -> Geometry, Transform
trim = TrimWithRegion(Curve=voronoi, Region=move_2.Geometry)  # -> Inside, Outside
incurve = PointInCurve(Point=cullpt.Points, Curve=move_2.Geometry)  # -> Relationship, Point
trim_2 = TrimWithRegion(Curve=crv, Region=move_2.Geometry)  # -> Inside, Outside
trim_3 = TrimWithRegion(Curve=scale_2.Geometry, Region=move_2.Geometry)  # -> Inside, Outside
trim_4 = TrimWithRegion(Curve=scale.Geometry, Region=move_2.Geometry)  # -> Inside, Outside
equals = Equality(FirstNumber=incurve.Relationship, SecondNumber=1)  # -> Equality, Inequality
equals_2 = Equality(FirstNumber=incurve.Relationship, SecondNumber=[1, 2])  # -> Equality, Inequality
crv_2 = Curve(trim_3.Inside)
crv_3 = Curve(trim_2.Inside)
crv_4 = Curve(trim_4.Inside)
crv_5 = Curve(trim.Inside)
or = GateOr(A=equals.Equality, B=equals_2.Equality)
explode_2 = Explode(Curve=crv_4, Recursive=True)  # -> Segments, Vertices
explode_3 = Explode(Curve=crv_2, Recursive=True)  # -> Segments, Vertices
not = GateNot(A=or)
pshift = ShiftPaths(Data=explode_2.Vertices, Offset=-1)
cull = CullPattern(List=cullpt.Points, CullPattern=or)
pshift_2 = ShiftPaths(Data=explode_3.Vertices, Offset=-1)
cull_2 = CullPattern(List=cullpt.Points, CullPattern=not)
pline = PolyLine(Vertices=pshift, Closed=invert(False))
pline_2 = PolyLine(Vertices=pshift_2, Closed=invert(False))
explode_4 = Explode(Curve=pline_2, Recursive=True)  # -> Segments, Vertices
cullpt_2 = CullDuplicates(Points=explode_4.Vertices, Tolerance=0.1, CullMode=3)  # -> Points, Indices, Valence
cps = ClosestPoints(Point=graft(debrep_2.Vertices), Cloud=flatten(cullpt_2.Points), Count=Slider(3, range=0..10))  # -> ClosestPoint, CPIndex, Distance
merge = Merge(Data1=simplify(graft(debrep_2.Vertices)), Data2=simplify(cps.ClosestPoint))
pline_3 = PolyLine(Vertices=merge, Closed=invert(False))
debrep_3 = DeconstructBrep(Brep=pline_3)  # -> Faces, Edges, Vertices
lng = ListLength(List=debrep_3.Edges)
equals_3 = Equality(FirstNumber=lng, SecondNumber=4)  # -> Equality, Inequality
brep = Brep(pline)
brep_2 = Brep(move_2.Geometry)
cull_3 = CullPattern(List=pline_3, CullPattern=equals_3.Equality)
brep_3 = Brep([pline_2, cull_3])
preview = CustomPreview(Geometry=brep, Material=ColourSwatch(SwatchColor=RGB(255, 255, 0)))
preview_2 = CustomPreview(Geometry=brep_3, Material=ColourSwatch(SwatchColor=RGB(255, 0, 204)))
preview_3 = CustomPreview(Geometry=brep_2, Material=ColourSwatch(SwatchColor=RGB(0, 255, 247)))
crv_6 = Curve(pline)
pt_3 = Point(cull_2)
pt_4 = Point(cull)
crv_7 = Curve(crv_3)
crv_8 = Curve(move_2.Geometry)
crv_9 = Curve(crv_5)
crv_10 = Curve(pline_2)

entwine = Entwine(
    Branch00=crv_8,
    Branch01=crv_10,
    Branch02=crv_9,
    Branch03=crv_7,
    Branch04=crv_6,
    Branch05=pt_4,
    Branch06=pt_3,
    Branch07=brep,
    Branch08=brep_3,
    Branch09=brep_2,
    FlattenInputs=True)

number_slider_4 = Slider(4, range=0..10)
number_slider_5 = Slider(5, range=0..10)
number_slider_6 = Slider(1, range=0..10)
trigrid = Triangular(Plane=PlaneXY(0, 0, 0), Size=spacing, ExtentX=ex, ExtentY=ey)  # -> Cells, Points
pt_5 = Point(trigrid.Points)
bbox_2 = BoundingBox(Content=flatten(pt_5), Plane=PlaneXY(0, 0, 0), UnionBox=True)  # -> Box, Box_2
debrep_4 = DeconstructBrep(Brep=bbox_2.Box)  # -> Faces, Edges, Vertices
join_2 = JoinCurves(Curves=debrep_4.Edges, Preserve=False)
area_3 = Area(Geometry=join_2)  # -> Area, Centroid
neg_2 = Negative(Value=area_3.Centroid)
move_3 = Move(Geometry=trigrid.Cells, Motion=neg_2)  # -> Geometry, Transform
crv_11 = Curve(move_3.Geometry)
move_4 = Move(Geometry=join_2, Motion=neg_2)  # -> Geometry, Transform
explode_5 = Explode(Curve=crv_11, Recursive=True)  # -> Segments, Vertices
debrep_5 = DeconstructBrep(Brep=move_4.Geometry)  # -> Faces, Edges, Vertices
pt_6 = Point(explode_5.Vertices)
cullpt_3 = CullDuplicates(Points=flatten(pt_6), Tolerance=0.1, CullMode=3)  # -> Points, Indices, Valence
xy_3 = XYPlane(Origin=Point(0, 0, 0))
voronoi_2 = Voronoi(Points=cullpt_3.Points, Plane=xy_3, BruteForceOverride=False)
area_4 = Area(Geometry=crv_11)  # -> Area, Centroid
scale_3 = Scale(Geometry=voronoi_2, Center=cullpt_3.Points, Factor=0.5)  # -> Geometry, Transform
scale_4 = Scale(Geometry=crv_11, Center=area_4.Centroid, Factor=0.5)  # -> Geometry, Transform
trim_5 = TrimWithRegion(Curve=voronoi_2, Region=move_4.Geometry)  # -> Inside, Outside
incurve_2 = PointInCurve(Point=cullpt_3.Points, Curve=move_4.Geometry)  # -> Relationship, Point
trim_6 = TrimWithRegion(Curve=crv_11, Region=move_4.Geometry)  # -> Inside, Outside
trim_7 = TrimWithRegion(Curve=scale_4.Geometry, Region=move_4.Geometry)  # -> Inside, Outside
trim_8 = TrimWithRegion(Curve=scale_3.Geometry, Region=move_4.Geometry)  # -> Inside, Outside
equals_4 = Equality(FirstNumber=incurve_2.Relationship, SecondNumber=1)  # -> Equality, Inequality
equals_5 = Equality(FirstNumber=incurve_2.Relationship, SecondNumber=[1, 2])  # -> Equality, Inequality
crv_12 = Curve(trim_7.Inside)
crv_13 = Curve(trim_6.Inside)
crv_14 = Curve(trim_8.Inside)
crv_15 = Curve(trim_5.Inside)
or_2 = GateOr(A=equals_4.Equality, B=equals_5.Equality)
explode_6 = Explode(Curve=crv_14, Recursive=True)  # -> Segments, Vertices
explode_7 = Explode(Curve=crv_12, Recursive=True)  # -> Segments, Vertices
not_2 = GateNot(A=or_2)
pshift_3 = ShiftPaths(Data=explode_6.Vertices, Offset=-1)
cull_4 = CullPattern(List=cullpt_3.Points, CullPattern=or_2)
pshift_4 = ShiftPaths(Data=explode_7.Vertices, Offset=-1)
cull_5 = CullPattern(List=cullpt_3.Points, CullPattern=not_2)
pline_4 = PolyLine(Vertices=pshift_3, Closed=invert(False))
pline_5 = PolyLine(Vertices=pshift_4, Closed=invert(False))
explode_8 = Explode(Curve=pline_5, Recursive=True)  # -> Segments, Vertices
cullpt_4 = CullDuplicates(Points=explode_8.Vertices, Tolerance=0.1, CullMode=3)  # -> Points, Indices, Valence
cps_2 = ClosestPoints(Point=graft(debrep_5.Vertices), Cloud=flatten(cullpt_4.Points), Count=Slider(2, range=0..10))  # -> ClosestPoint, CPIndex, Distance
merge_2 = Merge(Data1=simplify(graft(debrep_5.Vertices)), Data2=simplify(cps_2.ClosestPoint))
pline_6 = PolyLine(Vertices=merge_2, Closed=invert(False))
brep_4 = Brep(pline_4)
brep_5 = Brep(move_4.Geometry)
preview_4 = CustomPreview(Geometry=brep_4, Material=ColourSwatch(SwatchColor=RGB(255, 255, 0)))
preview_5 = CustomPreview(Geometry=brep_5, Material=ColourSwatch(SwatchColor=RGB(0, 255, 247)))
crv_16 = Curve(pline_4)
pt_7 = Point(cull_5)
pt_8 = Point(cull_4)
crv_17 = Curve(crv_13)
crv_18 = Curve(move_4.Geometry)
crv_19 = Curve(crv_15)
crv_20 = Curve([pline_5, pline_6])

cls = Closed(Curve=pline_5)  # -> Closed, Periodic
dispatch = Dispatch(List=pline_5, DispatchPattern=cls.Closed)  # -> ListA, ListB
geo = Geometry(dispatch.ListA)

brep_6 = Brep(geo)
preview_6 = CustomPreview(Geometry=brep_6, Material=ColourSwatch(SwatchColor=RGB(255, 0, 204)))

entwine_2 = Entwine(
    Branch00=crv_18,
    Branch01=crv_20,
    Branch02=crv_19,
    Branch03=crv_17,
    Branch04=crv_16,
    Branch05=pt_8,
    Branch06=pt_7,
    Branch07=brep_4,
    Branch08=brep_6,
    Branch09=brep_5,
    FlattenInputs=True)

sqgrid = Square(Plane=PlaneXY(0, 0, 0), Size=spacing, ExtentX=ex, ExtentY=ey)  # -> Cells, Points
area_5 = Area(Geometry=sqgrid.Cells)  # -> Area, Centroid
pt_9 = Point(area_5.Centroid)
bbox_3 = BoundingBox(Content=flatten(pt_9), Plane=PlaneXY(0, 0, 0), UnionBox=True)  # -> Box, Box_2
debrep_6 = DeconstructBrep(Brep=bbox_3.Box)  # -> Faces, Edges, Vertices
join_3 = JoinCurves(Curves=debrep_6.Edges, Preserve=False)
area_6 = Area(Geometry=join_3)  # -> Area, Centroid
neg_3 = Negative(Value=area_6.Centroid)
move_5 = Move(Geometry=sqgrid.Cells, Motion=neg_3)  # -> Geometry, Transform
crv_21 = Curve(move_5.Geometry)
move_6 = Move(Geometry=join_3, Motion=neg_3)  # -> Geometry, Transform
explode_9 = Explode(Curve=crv_21, Recursive=True)  # -> Segments, Vertices
debrep_7 = DeconstructBrep(Brep=move_6.Geometry)  # -> Faces, Edges, Vertices
pt_10 = Point(explode_9.Vertices)
cullpt_5 = CullDuplicates(Points=flatten(pt_10), Tolerance=0.1, CullMode=3)  # -> Points, Indices, Valence
voronoi_3 = Voronoi(Points=cullpt_5.Points, Plane=xy, BruteForceOverride=False)
area_7 = Area(Geometry=crv_21)  # -> Area, Centroid
scale_5 = Scale(Geometry=voronoi_3, Center=cullpt_5.Points, Factor=0.5)  # -> Geometry, Transform
scale_6 = Scale(Geometry=crv_21, Center=area_7.Centroid, Factor=0.5)  # -> Geometry, Transform
trim_9 = TrimWithRegion(Curve=voronoi_3, Region=move_6.Geometry)  # -> Inside, Outside
incurve_3 = PointInCurve(Point=cullpt_5.Points, Curve=move_6.Geometry)  # -> Relationship, Point
trim_10 = TrimWithRegion(Curve=crv_21, Region=move_6.Geometry)  # -> Inside, Outside
trim_11 = TrimWithRegion(Curve=scale_6.Geometry, Region=move_6.Geometry)  # -> Inside, Outside
trim_12 = TrimWithRegion(Curve=scale_5.Geometry, Region=move_6.Geometry)  # -> Inside, Outside
equals_6 = Equality(FirstNumber=incurve_3.Relationship, SecondNumber=1)  # -> Equality, Inequality
equals_7 = Equality(FirstNumber=incurve_3.Relationship, SecondNumber=[1, 2])  # -> Equality, Inequality
crv_22 = Curve(trim_11.Inside)
crv_23 = Curve(trim_10.Inside)
crv_24 = Curve(trim_12.Inside)
crv_25 = Curve(trim_9.Inside)
or_3 = GateOr(A=equals_6.Equality, B=equals_7.Equality)
explode_10 = Explode(Curve=crv_24, Recursive=True)  # -> Segments, Vertices
explode_11 = Explode(Curve=crv_22, Recursive=True)  # -> Segments, Vertices
not_3 = GateNot(A=or_3)
pshift_5 = ShiftPaths(Data=explode_10.Vertices, Offset=-1)
cull_6 = CullPattern(List=cullpt_5.Points, CullPattern=or_3)
pshift_6 = ShiftPaths(Data=explode_11.Vertices, Offset=-1)
cull_7 = CullPattern(List=cullpt_5.Points, CullPattern=not_3)
pline_7 = PolyLine(Vertices=pshift_5, Closed=invert(False))
pline_8 = PolyLine(Vertices=pshift_6, Closed=invert(False))
explode_12 = Explode(Curve=pline_8, Recursive=True)  # -> Segments, Vertices
cullpt_6 = CullDuplicates(Points=explode_12.Vertices, Tolerance=0.1, CullMode=3)  # -> Points, Indices, Valence
cps_3 = ClosestPoints(Point=graft(debrep_7.Vertices), Cloud=flatten(cullpt_6.Points), Count=Slider(3, range=0..10))  # -> ClosestPoint, CPIndex, Distance
brep_7 = Brep(pline_7)
brep_8 = Brep(move_6.Geometry)
preview_7 = CustomPreview(Geometry=brep_7, Material=ColourSwatch(SwatchColor=RGB(255, 255, 0)))
preview_8 = CustomPreview(Geometry=brep_8, Material=ColourSwatch(SwatchColor=RGB(0, 255, 247)))
crv_26 = Curve(pline_7)
pt_11 = Point(cull_7)
pt_12 = Point(cull_6)
crv_27 = Curve(crv_23)
crv_28 = Curve(move_6.Geometry)
crv_29 = Curve(crv_25)
crv_30 = Curve(pline_8)

item = ListItem(List=cps_3.ClosestPoint, Index=0, Wrap=True)  # -> Item, Item1, Item2
rec_3pt = Rectangle3Pt(PointA=item.Item, PointB=item.Item2, PointC=item.Item1)  # -> Rectangle, Length

brep_9 = Brep([pline_8, rec_3pt.Rectangle])
preview_9 = CustomPreview(Geometry=brep_9, Material=ColourSwatch(SwatchColor=RGB(255, 0, 204)))

entwine_3 = Entwine(
    Branch00=crv_28,
    Branch01=crv_30,
    Branch02=crv_29,
    Branch03=crv_27,
    Branch04=crv_26,
    Branch05=pt_12,
    Branch06=pt_11,
    Branch07=brep_7,
    Branch08=brep_9,
    Branch09=brep_8,
    FlattenInputs=True)
filter = StreamFilter(Gate=type, Stream0=entwine_3, Stream1=entwine_2, Stream2=entwine)
bang = ExplodeTree(Data=filter)  # -> Branch0, Branch1, Branch2, Branch3, Branch4, Branch5, Branch6, Branch7, Branch8, Branch9

# ---- group: RH_OUT: curve
crv_31 = Curve([bang.Branch0, bang.Branch1, bang.Branch2, bang.Branch3, bang.Branch4])
